# Grasshopper definition apt_lb.gh (Grasshopper 1.0.7)

geo = Geometry(<curve referenced from the Rhino model>)
geo_2 = Geometry(geo)
area = Area(Geometry=geo)  # -> Area, Centroid
scale = Scale(Geometry=geo, Center=area.Centroid, Factor="0.5")  # -> Geometry, Transform
geo_3 = Geometry(<curve referenced from the Rhino model>)
geo_4 = Geometry(geo_3)
area_2 = Area(Geometry=geo_3)  # -> Area, Centroid
scale_2 = Scale(Geometry=geo_3, Center=area_2.Centroid, Factor="0.5")  # -> Geometry, Transform
vec = VectorXYZ(XComponent=0, YComponent=0, ZComponent="9")  # -> Vector, Length
boundary = BoundarySurfaces(Edges=geo_2)
extr = Extrude(Base=boundary, Direction=vec.Vector)
vec_2 = VectorXYZ(XComponent=0, YComponent=0, ZComponent="9")  # -> Vector, Length
boundary_2 = BoundarySurfaces(Edges=geo_4)
buildingsolid = DFBuildingFromSolid(bldg_geo=flatten(extr), floor_to_floor="@3", perim_offset="7.5", run=Toggle(False))  # -> report, buildings; plug-in component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
extr_2 = Extrude(Base=boundary_2, Direction=vec_2.Vector)
model = DFModel(buildings=flatten(buildingsolid.buildings))  # -> report, model; plug-in component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
buildingsolid_2 = DFBuildingFromSolid(bldg_geo=flatten(extr_2), floor_to_floor="@3", perim_offset="7.5", run=Toggle(False))  # -> report, buildings; plug-in component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
vizall = DFVizualizeAll(df_objs=flatten(model.model))  # -> geo; plug-in component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
model_2 = DFModel(buildings=flatten(buildingsolid_2.buildings))  # -> report, model; plug-in component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

# ---- group: tower
geo_5 = Geometry([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])

# ---- group: court_shade
geo_6 = Geometry([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])

# ---- group: court
geo_7 = Geometry([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])

# ---- group: tower_shade
geo_8 = Geometry([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])

# ----
panel = Panel("http://climate.onebuilding.org/WMO_Region_4_North_and_Central_America/USA_United_States_of_America/IL_Illinois/USA_IL_Chicago.OHare.Intl.AP.725300_TMY3.zip")
panel_2 = Panel("http://climate.onebuilding.org/WMO_Region_4_North_and_Central_America/USA_United_States_of_America/TX_Texas/USA_TX_Cotulla.Muni.AP.722526_TMY3.zip")
python = GhPythonScript(x=geo_8, y=geo_6)  # -> a; inputs x: list, y: list
# ---------- python: Python ----------
def list_to_tree(input, none_and_holes=True, source=[0]):
    """Transforms nestings of lists or tuples to a Grasshopper DataTree"""
    from Grasshopper import DataTree as Tree
    from Grasshopper.Kernel.Data import GH_Path as Path
    from System import Array
    def proc(input,tree,track):
        path = Path(Array[int](track))
        if len(input) == 0 and none_and_holes: tree.EnsurePath(path); return
        for i,item in enumerate(input):
            if hasattr(item, '__iter__'): #if list or tuple
                track.append(i); proc(item,tree,track); track.pop()
            else:
                if none_and_holes: tree.Insert(item,path,i)
                elif item is not None: tree.Add(item,path)
    if input is not None: t=Tree[object]();proc(input,t,source[:]);return t
    

a = list_to_tree([x, y])
# ---------- end python ----------
vizall_2 = DFVizualizeAll(df_objs=flatten(model_2.model))  # -> geo; plug-in component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
python_2 = GhPythonScript(x=geo_5, y=geo_7)  # -> a; inputs x: list, y: list; same code as python

# ---- group: tower
geo_9 = Geometry([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])

# ---- group: court_shade
geo_10 = Geometry([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])

# ---- group: court
geo_11 = Geometry([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])

# ---- group: tower_shade
geo_12 = Geometry([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])

# ----
panel_3 = Panel("""tower
court""")
panel_4 = Panel("http://climate.onebuilding.org/WMO_Region_4_North_and_Central_America/USA_United_States_of_America/IL_Illinois/USA_IL_Chicago.OHare.Intl.AP.725300_TMY3.zip")
merge = Merge(Data1=panel, Data4=panel_2)  # -> flatten(Result)
panel_5 = Panel("http://climate.onebuilding.org/WMO_Region_4_North_and_Central_America/USA_United_States_of_America/TX_Texas/USA_TX_Cotulla.Muni.AP.722526_TMY3.zip")
python_3 = GhPythonScript(x=geo_12, y=geo_10)  # -> a; inputs x: list, y: list; same code as python
python_4 = GhPythonScript(
    i=Slider(0, range=0..7),
    shade_lens="0.5, 48",
    shade_geoms=python,
    bld_geoms=python_2,
    bld_types=panel_3,
    levels="1",
    epws=merge)  # -> N, shade_len, shade_geom, bld_geom, epw, desc, desc_all; inputs i: Int32, shade_geoms: tree, bld_geoms: tree, bld_types: list, levels: Int32, epws: list
# ---------- python_4: Python ----------
import rhinoscriptsyntax as rs 
import Rhino.Geometry as rc

def tree_to_list(input, retrieve_base = lambda x: x[0]):
    """Returns a list representation of a Grasshopper DataTree"""
    def extend_at(path, index, simple_input, rest_list):
        target = path[index]
        if len(rest_list) <= target: rest_list.extend([None]*(target-len(rest_list)+1))
        if index == path.Length - 1:
            rest_list[target] = list(simple_input)
        else:
            if rest_list[target] is None: rest_list[target] = []
            extend_at(path, index+1, simple_input, rest_list[target])
    all = []
    for i in range(input.BranchCount):
        path = input.Path(i)
        extend_at(path, 0, input.Branch(path), all)
    return retrieve_base(all)
    
shade_lens = [float(_x) for _x in shade_lens.split(',')]
#shade_geoms = [tree_to_list(shade_geoms)[0]]
#bld_geoms = [tree_to_list(bld_geoms)[0]]
shade_geoms = tree_to_list(shade_geoms)
bld_geoms = tree_to_list(bld_geoms)

# filter out levels 
_bld_geoms = []
for bld_geom in bld_geoms:
    _bld_geom = []
    for g in bld_geom:
        _g = rs.coercegeometry(g)
        cpt = _g.GetBoundingBox(False).PointAt(0.5,0.5,0.5)
        flr_ht = int((cpt[2] - 1.5) / 3.0) + 1
        #print(flr_ht, levels, flr_ht <= levels)
        if flr_ht > levels:
            continue
        _bld_geom.append(g)
    if _bld_geom:
        _bld_geoms.append(_bld_geom)
bld_geoms = _bld_geoms


L = []
desc_all = []
for epw in epws:
    for bld_type, shade_geom, bld_geom in zip(bld_types, shade_geoms, bld_geoms):
        for shade_len in shade_lens:
            L.append([shade_len, shade_geom, bld_geom, epw])
            desc_all.append(
                "epw: {}\ntype: {}\nshade_len: {}".format(
                    epw.split("/")[-1].split(".zip")[0],
                    bld_type,
                    shade_len))

N = len(shade_lens) * len(shade_geoms) * len(epws) - 1
shade_len, shade_geom, bld_geom, epw = L[i]
desc = desc_all[i]
# ---------- end python_4 ----------
python_5 = GhPythonScript(x=geo_9, y=geo_11)  # -> a; inputs x: list, y: list; same code as python
data = Data(simplify(graft(python_4.desc_all)))
panel_6 = Panel("""tower
court""")
merge_2 = Merge(Data1=panel_4, Data4=panel_5)  # -> flatten(Result)
geo_13 = Geometry(python_4.shade_geom)
vec_3 = VectorXYZ(XComponent=0, YComponent=0, ZComponent=python_4.shade_len)  # -> Vector, Length
panel_7 = Panel(python_4.shade_len)
panel_8 = Panel(data)
panel_9 = Panel(python_4.epw)
panel_10 = Panel(python_4.desc)
python_6 = GhPythonScript(
    i=Slider(0, range=0..7),
    shade_lens="0.5, 48",
    shade_geoms=python_3,
    bld_geoms=python_5,
    bld_types=panel_6,
    levels="1",
    epws=merge_2)  # -> N, shade_len, shade_geom, bld_geom, epw, desc, desc_all; inputs i: Int32, shade_geoms: tree, bld_geoms: tree, bld_types: list, levels: Int32, epws: list; same code as python_4
extr_3 = Extrude(Base=geo_13, Direction=vec_3.Vector)
data_2 = Data(simplify(graft(python_6.desc_all)))
geo_14 = Geometry(python_6.shade_geom)
vec_4 = VectorXYZ(XComponent=0, YComponent=0, ZComponent=python_6.shade_len)  # -> Vector, Length
panel_11 = Panel(python_6.shade_len)
panel_12 = Panel(python_6.epw)
panel_13 = Panel(python_6.desc)
panel_14 = Panel(data_2)
geo_15 = Geometry(python_4.bld_geom)
extr_4 = Extrude(Base=geo_14, Direction=vec_4.Vector)
roomsolid = HBRoomFromSolid(geo=flatten(geo_15), conditioned=Toggle(False))  # -> report, rooms; plug-in component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
data_3 = Data(extr_3)
wires = BrepWireframe(Brep=flatten(data_3), Density=-1)  # -> flatten(Wireframe)
geo_16 = Geometry(python_6.bld_geom)
toggle = BooleanToggle(True)
roomsolid_2 = HBRoomFromSolid(geo=flatten(geo_16), conditioned=True)  # -> report, rooms; plug-in component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
data_4 = Data(extr_4)
solveadj = HBSolveAdjacency(rooms=flatten(roomsolid.rooms), adiabatic=Toggle(False), overwrite=toggle, run=toggle)  # -> report, adj_rooms; plug-in component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
bldgvintages = HBBuildingVintages({"ASHRAE 90.1 2013  |  IECC 2015": "2013", "ASHRAE 90.1 2010  |  IECC 2012": "2010", "ASHRAE 90.1 2007  |  IECC 2009": "2007", "ASHRAE 90.1 2004  |  IECC 2006": "2004", "1980-2004 (CBECS)": "1980_2004", "Pre-1980 (CBECS)": "pre_1980"}, selected="ASHRAE 90.1 2013  |  IECC 2015")
bldgvintages_2 = HBBuildingVintages({"ASHRAE 90.1 2013  |  IECC 2015": "2013", "ASHRAE 90.1 2010  |  IECC 2012": "2010", "ASHRAE 90.1 2007  |  IECC 2009": "2007", "ASHRAE 90.1 2004  |  IECC 2006": "2004", "1980-2004 (CBECS)": "1980_2004", "Pre-1980 (CBECS)": "pre_1980"}, selected="ASHRAE 90.1 2013  |  IECC 2015")
bldgprograms = HBBuildingPrograms({"LargeOffice", "MediumOffice", "SmallOffice", "MidriseApartment", "HighriseApartment", "Retail", "StripMall", "PrimarySchool", "SecondarySchool", "SmallHotel", "LargeHotel", "Hospital", "Outpatient", "Laboratory", "Warehouse", "SuperMarket", "FullServiceRestaurant", "QuickServiceRestaurant", "Courthouse", "LargeDataCenterHighITE", "LargeDataCenterLowITE", "SmallDataCenterHighITE", "SmallDataCenterLowITE"}, selected="MidriseApartment")
wires_2 = BrepWireframe(Brep=flatten(data_4), Density=-1)  # -> flatten(Wireframe)
climatezones = HBClimateZones({"1 - Very Hot": "1", "2 - Hot": "2", "3 - Warm": "3", "4 - Mixed": "4", "5 - Cool": "5", "6 - Cold": "6", "7 - Very Cold": "7", "8 - Subarctic": "8"}, selected="5 - Cool")
toggle_2 = BooleanToggle(True)
aperturesbyratio = HBAperturesByRatio(hb_objs=flatten(solveadj.adj_rooms), ratio="0.4", subdivide=Toggle(False))  # -> report, hb_objs; plug-in component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
solveadj_2 = HBSolveAdjacency(rooms=flatten(roomsolid_2.rooms), adiabatic=Toggle(False), overwrite=toggle_2, run=toggle_2)  # -> report, adj_rooms; plug-in component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
bldgvintages_3 = HBBuildingVintages({"ASHRAE 90.1 2013  |  IECC 2015": "2013", "ASHRAE 90.1 2010  |  IECC 2012": "2010", "ASHRAE 90.1 2007  |  IECC 2009": "2007", "ASHRAE 90.1 2004  |  IECC 2006": "2004", "1980-2004 (CBECS)": "1980_2004", "Pre-1980 (CBECS)": "pre_1980"}, selected="ASHRAE 90.1 2013  |  IECC 2015")
bldgvintages_4 = HBBuildingVintages({"ASHRAE 90.1 2013  |  IECC 2015": "2013", "ASHRAE 90.1 2010  |  IECC 2012": "2010", "ASHRAE 90.1 2007  |  IECC 2009": "2007", "ASHRAE 90.1 2004  |  IECC 2006": "2004", "1980-2004 (CBECS)": "1980_2004", "Pre-1980 (CBECS)": "pre_1980"}, selected="ASHRAE 90.1 2013  |  IECC 2015")
constrsetclimate = HBConstructionSetByClimate(climate_zone=climatezones, vintage=bldgvintages, constr_type="SteelFramed")  # -> constr_set; plug-in component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
searchprog = HBSearchPrograms(bldg_prog=bldgprograms, vintage=bldgvintages_2)  # -> room_prog; plug-in component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
bldgprograms_2 = HBBuildingPrograms({"LargeOffice", "MediumOffice", "SmallOffice", "MidriseApartment", "HighriseApartment", "Retail", "StripMall", "PrimarySchool", "SecondarySchool", "SmallHotel", "LargeHotel", "Hospital", "Outpatient", "Laboratory", "Warehouse", "SuperMarket", "FullServiceRestaurant", "QuickServiceRestaurant", "Courthouse", "LargeDataCenterHighITE", "LargeDataCenterLowITE", "SmallDataCenterHighITE", "SmallDataCenterLowITE"}, selected="MidriseApartment")
climatezones_2 = HBClimateZones({"1 - Very Hot": "1", "2 - Hot": "2", "3 - Warm": "3", "4 - Mixed": "4", "5 - Cool": "5", "6 - Cold": "6", "7 - Very Cold": "7", "8 - Subarctic": "8"}, selected="5 - Cool")
aperturesbyratio_2 = HBAperturesByRatio(hb_objs=flatten(solveadj_2.adj_rooms), ratio="0.4", subdivide=Toggle(False))  # -> report, hb_objs; plug-in component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
panel_15 = Panel(searchprog)
applyconstrset = HBApplyConstructionSet(rooms=aperturesbyratio.hb_objs, constr_set=constrsetclimate)  # -> rooms; plug-in component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
roomattr = HBRoomAttributes({"Display Name": "display_name", "Simulation Name (Identifier)": "identifier", "Multiplier": "multiplier", "Story": "story", "Volume": "volume", "Gross Floor Area": "floor_area", "Exposed Area": "exposed_area", "Exterior Wall Area": "exterior_wall_area", "Exterior Aperture Area": "exterior_aperture_area", "Average Floor Elevation": "average_floor_height"}, selected="Gross Floor Area")  # disabled
item = ListItem(List=searchprog, Index=0, Wrap=True)
constrsetclimate_2 = HBConstructionSetByClimate(climate_zone=climatezones_2, vintage=bldgvintages_3, constr_type="SteelFramed")  # -> constr_set; plug-in component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
searchprog_2 = HBSearchPrograms(bldg_prog=bldgprograms_2, vintage=bldgvintages_4)  # -> room_prog; plug-in component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
applyprogram = HBApplyProgramType(rooms=flatten(applyconstrset), program=item)  # -> report, rooms; plug-in component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
panel_16 = Panel("1")  # disabled
decnstrconstrset = HBDeconstructConstructionSet(constr_set=constrsetclimate)  # -> exterior_wall, exterior_roof, exposed_floor, ground_wall, ground_roof, ground_floor, window, skylight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; disabled; plug-in component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
panel_17 = Panel(searchprog_2)
decnstrconstrset_2 = HBDeconstructConstructionSet(constr_set=constrsetclimate)  # -> exterior_wall, exterior_roof, exposed_floor, ground_wall, ground_roof, ground_floor, window, skylight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; disabled; plug-in component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
applyconstrset_2 = HBApplyConstructionSet(rooms=aperturesbyratio_2.hb_objs, constr_set=constrsetclimate_2)  # -> rooms; plug-in component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
labelrooms = HBLabelRooms(rooms_model=flatten(applyprogram.rooms), attribute=roomattr, txt_height=panel_16)  # -> label_text, base_pts, labels, wire_frame; disabled; plug-in component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
roomattr_2 = HBRoomAttributes({"Display Name": "display_name", "Simulation Name (Identifier)": "identifier", "Multiplier": "multiplier", "Story": "story", "Volume": "volume", "Gross Floor Area": "floor_area", "Exposed Area": "exposed_area", "Exterior Wall Area": "exterior_wall_area", "Exterior Aperture Area": "exterior_aperture_area", "Average Floor Elevation": "average_floor_height"}, selected="Gross Floor Area")  # disabled
item_2 = ListItem(List=searchprog_2, Index=0, Wrap=True)
decnstrconstr = HBDeconstructConstruction(constr=decnstrconstrset.window)  # -> materials, layers, r_val_si, r_val_ip, u_fac_si, u_fac_ip, t_sol, t_vis; disabled; plug-in component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
decnstrconstr_2 = HBDeconstructConstruction(constr=decnstrconstrset_2.exterior_wall)  # -> materials, layers, r_val_si, r_val_ip, u_fac_si, u_fac_ip, t_sol, t_vis; disabled; plug-in component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
applyprogram_2 = HBApplyProgramType(rooms=flatten(applyconstrset_2), program=item_2)  # -> report, rooms; plug-in component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
panel_18 = Panel(labelrooms.label_text)  # disabled
panel_19 = Panel("1")  # disabled
decnstrconstrset_3 = HBDeconstructConstructionSet(constr_set=constrsetclimate_2)  # -> exterior_wall, exterior_roof, exposed_floor, ground_wall, ground_roof, ground_floor, window, skylight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; disabled; plug-in component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
panel_20 = Panel(decnstrconstr.u_fac_si)  # disabled
decnstrconstrset_4 = HBDeconstructConstructionSet(constr_set=constrsetclimate_2)  # -> exterior_wall, exterior_roof, exposed_floor, ground_wall, ground_roof, ground_floor, window, skylight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; disabled; plug-in component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
panel_21 = Panel(decnstrconstr_2.r_val_si)  # disabled
labelrooms_2 = HBLabelRooms(rooms_model=flatten(applyprogram_2.rooms), attribute=roomattr_2, txt_height=panel_19)  # -> label_text, base_pts, labels, wire_frame; disabled; plug-in component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
decnstrconstr_3 = HBDeconstructConstruction(constr=decnstrconstrset_3.window)  # -> materials, layers, r_val_si, r_val_ip, u_fac_si, u_fac_ip, t_sol, t_vis; disabled; plug-in component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
decnstrconstr_4 = HBDeconstructConstruction(constr=decnstrconstrset_4.exterior_wall)  # -> materials, layers, r_val_si, r_val_ip, u_fac_si, u_fac_ip, t_sol, t_vis; disabled; plug-in component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
geo_17 = Geometry(data_3)
panel_22 = Panel(labelrooms_2.label_text)  # disabled
panel_23 = Panel(decnstrconstr_3.u_fac_si)  # disabled
panel_24 = Panel(decnstrconstr_4.r_val_si)  # disabled
adiabaticbytype = HBAdiabaticByType(hb_objs=flatten(applyprogram.rooms), interior_floors=Toggle(True))  # -> hb_objs; plug-in component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
shade = HBShade(geo=geo_17)  # -> report, shades; disabled; plug-in component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
lng = ListLength(List=shade.shades)
toggle_3 = BooleanToggle(False)
geo_18 = Geometry(data_4)
panel_25 = Panel(lng)
idealair = HBIdealAir(rooms=flatten(adiabaticbytype))  # -> report, rooms; plug-in component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
adiabaticbytype_2 = HBAdiabaticByType(hb_objs=flatten(applyprogram_2.rooms), interior_floors=Toggle(True))  # -> hb_objs; plug-in component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
shade_2 = HBShade(geo=geo_18)  # -> report, shades; disabled; plug-in component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
lng_2 = ListLength(List=shade_2.shades)
toggle_4 = BooleanToggle(False)
panel_26 = Panel(lng_2)
model_3 = HBModel(rooms=flatten(idealair.rooms), shades=flatten(shade.shades), name="model_B")  # -> report, model; plug-in component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
idealair_2 = HBIdealAir(rooms=flatten(adiabaticbytype_2))  # -> report, rooms; plug-in component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
data_5 = Data(model_3.model)
model_4 = HBModel(rooms=flatten(idealair_2.rooms), shades=flatten(shade_2.shades), name="model_A")  # -> report, model; plug-in component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
data_6 = Data(model_4.model)
data_7 = Data(python_4.epw)
panel_27 = Panel(data_7)
vizbytype = HBVisualizeByType(hb_objs=data_5)  # -> walls, interior_walls, roofs, ceilings, exterior_floors, interior_floors, air_walls, apertures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; plug-in component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
vizbybc = HBVizualizeByBC(hb_objs=data_5)  # -> outdoors, surface, ground, adiabatic, other, wire_frame; plug-in component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
data_8 = Data(python_6.epw)
panel_28 = Panel(data_8)
downloadepw = LBDownloadWeather(weather_URL=panel_27)  # -> epw_file, stat_file, ddy_file; plug-in component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
swatch = ColourSwatch(SwatchColor=RGB(0, 0, 0))  # disabled
geo_19 = Geometry(vizbytype.interior_apertures)
preview = CustomPreview(Geometry=vizbytype.wire_frame, Material=swatch)  # disabled
importepw = LBImportEPW(epw_file=downloadepw.epw_file)  # -> location, dry_bulb_temperature, dew_point_temperature, relative_humidity, wind_speed, wind_direction, direct_normal_rad, diffuse_horizontal_rad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; plug-in component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
toggle_5 = BooleanToggle(True)
preview_2 = CustomPreview(Geometry=vizbybc.wire_frame, Material=ColourSwatch(SwatchColor=RGB(0, 0, 0)))
preview_3 = CustomPreview(Geometry=vizbybc.adiabatic, Material=ColourSwatch(SwatchColor=RGBA(255, 0, 0, 100)))
vizbytype_2 = HBVisualizeByType(hb_objs=data_6)  # -> walls, interior_walls, roofs, ceilings, exterior_floors, interior_floors, air_walls, apertures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; plug-in component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
vizbybc_2 = HBVizualizeByBC(hb_objs=data_6)  # -> outdoors, surface, ground, adiabatic, other, wire_frame; plug-in component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
shadowcalc = HBShadowCalculation(solar_dist="1", calc_method="PolygonClipping")  # -> shadow_calc; plug-in component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
simoutput = HBSimulationOutput(
    zone_energy_use=toggle_5,
    hvac_energy_use=toggle_5,
    gains_and_losses=toggle_5,
    comfort_metrics=toggle_5,
    surface_temperature=toggle_5,
    surface_energy_flow=toggle_5)  # -> report, sim_output; plug-in component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
downloadepw_2 = LBDownloadWeather(weather_URL=panel_28)  # -> epw_file, stat_file, ddy_file; plug-in component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
swatch_2 = ColourSwatch(SwatchColor=RGB(0, 0, 0))  # disabled
pt = Point(Point(149, -72, 0))  # disabled
panel_29 = Panel("2")  # disabled
toggle_6 = BooleanToggle(True)
sunpath = LBSunPath(location=importepw.location, center_pt=pt, scale=panel_29)  # -> report, vectors, altitudes, azimuths, hoys, sun_pts, analemma, daily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; disabled; plug-in component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
geo_20 = Geometry(vizbytype_2.interior_apertures)
preview_4 = CustomPreview(Geometry=vizbytype_2.wire_frame, Material=swatch_2)  # disabled
importepw_2 = LBImportEPW(epw_file=downloadepw_2.epw_file)  # -> location, dry_bulb_temperature, dew_point_temperature, relative_humidity, wind_speed, wind_direction, direct_normal_rad, diffuse_horizontal_rad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; plug-in component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
toggle_7 = BooleanToggle(True)
preview_5 = CustomPreview(Geometry=vizbybc_2.wire_frame, Material=ColourSwatch(SwatchColor=RGB(0, 0, 0)))
preview_6 = CustomPreview(Geometry=vizbybc_2.adiabatic, Material=ColourSwatch(SwatchColor=RGBA(255, 0, 0, 100)))
simpar = HBSimulationParameter(output=simoutput.sim_output, timestep=6, shadow_calc=shadowcalc)  # -> sim_par; plug-in component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
panel_30 = Panel("0.5")  # disabled
shadowcalc_2 = HBShadowCalculation(solar_dist="1", calc_method="PolygonClipping")  # -> shadow_calc; plug-in component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
simoutput_2 = HBSimulationOutput(
    zone_energy_use=toggle_7,
    hvac_energy_use=toggle_7,
    gains_and_losses=toggle_7,
    comfort_metrics=toggle_7,
    surface_temperature=toggle_7,
    surface_energy_flow=toggle_7)  # -> report, sim_output; plug-in component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
pt_2 = Point(Point(149, -72, 0))  # disabled
panel_31 = Panel("2")  # disabled
toggle_8 = BooleanToggle(True)
dash = DashPattern(Curve=sunpath.analemma, Pattern=panel_30)  # -> Dashes, Gaps; disabled
geo_21 = Geometry(sunpath.compass)  # disabled
sunpath_2 = LBSunPath(location=importepw_2.location, center_pt=pt_2, scale=panel_31)  # -> report, vectors, altitudes, azimuths, hoys, sun_pts, analemma, daily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; disabled; plug-in component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
modeltoosm = HBModelToOSM(model=data_5, epw_file=downloadepw.epw_file, sim_par=simpar, write=toggle_6, run=toggle_6)  # -> report, jsons, osw, osm, idf, sql, zsz, rdd, html; plug-in component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
panel_32 = Panel(modeltoosm.report)
simpar_2 = HBSimulationParameter(output=simoutput_2.sim_output, timestep=6, shadow_calc=shadowcalc_2)  # -> sim_par; plug-in component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
panel_33 = Panel("0.5")  # disabled
dash_2 = DashPattern(Curve=sunpath_2.analemma, Pattern=panel_33)  # -> Dashes, Gaps; disabled
geo_22 = Geometry(sunpath_2.compass)  # disabled
modeltoosm_2 = HBModelToOSM(model=data_6, epw_file=downloadepw_2.epw_file, sim_par=simpar_2, write=toggle_8, run=toggle_8)  # -> report, jsons, osw, osm, idf, sql, zsz, rdd, html; plug-in component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
panel_34 = Panel(modeltoosm_2.report)
panel_35 = Panel("3")  # disabled
panel_36 = Panel("0.8")  # disabled
panel_37 = Panel("1")  # disabled
faceresult = HBReadFaceResult(sql=modeltoosm.sql)  # -> face_indoor_temp, face_outdoor_temp, face_energy_flow; plug-in component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
roomenergyresult = HBReadRoomEnergyResult(sql=modeltoosm.sql)  # -> cooling, heating, lighting, electric_equip, gas_equip, hot_water, fan_electric, pump_electric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; plug-in component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
roomcomfortresult = HBReadRoomComfortResult(sql=modeltoosm.sql)  # -> oper_temp, air_temp, rad_temp, rel_humidity; plug-in component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
annualloads = HBAnnualLoads(
    rooms=data_5,
    shades=shade.shades,
    epw_file=downloadepw.epw_file,
    timestep=panel_37,
    cool_cop=panel_35,
    heat_cop=panel_36,
    run_bal=toggle_6,
    run=toggle_6)  # -> report, total_load, cooling, heating, lighting, equip, hot_water, balance; disabled; plug-in component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
panel_38 = Panel("""0
1
2
3""")  # disabled
data_9 = Data(data_5)
item_3 = ListItem(List=roomcomfortresult.air_temp, Index="0", Wrap=True)
item_4 = ListItem(List=annualloads.total_load, Index=panel_38, Wrap=True)  # disabled
ma = MassAddition(Input=item_4)  # -> Result, PartialResults; disabled
python_7 = GhPythonScript(x=python_4.epw, y=ma.Result)  # -> a; disabled
# ---------- python_7: Python ----------
city = x.split("/")[-1].split(".zip")[0]
eui = str(round(y, 2))

a = "City: {}\nEUI: {} kWh/m2".format(city, eui)
# ---------- end python_7 ----------
panel_39 = Panel(python_7)  # disabled
xdata = LBDeconstructData(data=importepw.dry_bulb_temperature)  # -> header, values; plug-in component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
xdata_2 = LBDeconstructData(data=item_3)  # -> header, values; plug-in component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
panel_40 = Panel("3")  # disabled
panel_41 = Panel(annualloads.total_load)  # disabled
panel_42 = Panel("0.8")  # disabled
panel_43 = Panel(ma.Result)  # disabled
panel_44 = Panel("1")  # disabled
faceresult_2 = HBReadFaceResult(sql=modeltoosm_2.sql)  # -> face_indoor_temp, face_outdoor_temp, face_energy_flow; plug-in component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
roomenergyresult_2 = HBReadRoomEnergyResult(sql=modeltoosm_2.sql)  # -> cooling, heating, lighting, electric_equip, gas_equip, hot_water, fan_electric, pump_electric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; plug-in component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
roomcomfortresult_2 = HBReadRoomComfortResult(sql=modeltoosm_2.sql)  # -> oper_temp, air_temp, rad_temp, rel_humidity; plug-in component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
panel_45 = Panel("19")  # disabled
panel_46 = Panel("50")  # disabled
annualloads_2 = HBAnnualLoads(
    rooms=data_6,
    shades=shade_2.shades,
    epw_file=downloadepw_2.epw_file,
    timestep=panel_44,
    cool_cop=panel_40,
    heat_cop=panel_42,
    run_bal=toggle_8,
    run=toggle_8)  # -> report, total_load, cooling, heating, lighting, equip, hot_water, balance; disabled; plug-in component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
colrange = LBColorRange(index=panel_45)  # -> colors; disabled; plug-in component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
loadbalance = HBThermalLoadBalance(
    rooms_model=flatten(data_5),
    cooling=roomenergyresult.cooling,
    heating=roomenergyresult.heating,
    lighting=roomenergyresult.lighting,
    electric_equip=roomenergyresult.electric_equip,
    gas_equip=roomenergyresult.gas_equip,
    people_gain=roomenergyresult.people_gain,
    solar_gain=roomenergyresult.solar_gain,
    infiltration_load=roomenergyresult.infiltration_load,
    mech_vent_load=roomenergyresult.mech_vent_load,
    face_energy_flow=faceresult.face_energy_flow)  # -> report, balance, balance_storage, norm_bal, norm_bal_storage; plug-in component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
neg = Negative(Value=panel_46)  # disabled
panel_47 = Panel("""0
1
2
3""")  # disabled
data_10 = Data(data_6)
panel_48 = Panel("1.5")  # disabled
item_5 = ListItem(List=roomcomfortresult_2.air_temp, Index="0", Wrap=True)
legendpar = LBLegendParameters(min=neg, max=panel_46, colors=colrange, text_height=panel_48)  # -> leg_par; disabled; plug-in component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
item_6 = ListItem(List=annualloads_2.total_load, Index=panel_47, Wrap=True)  # disabled
ma_2 = MassAddition(Input=item_6)  # -> Result, PartialResults; disabled
python_8 = GhPythonScript(x=python_6.epw, y=ma_2.Result)  # -> a; disabled; same code as python_7
panel_49 = Panel(python_8)  # disabled
xdata_3 = LBDeconstructData(data=importepw_2.dry_bulb_temperature)  # -> header, values; plug-in component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
toggle_9 = BooleanToggle(True)  # disabled
xdata_4 = LBDeconstructData(data=item_5)  # -> header, values; plug-in component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
pt_3 = Point(Point(211, -113, 0))  # disabled
panel_50 = Panel("5")  # disabled
panel_51 = Panel(annualloads_2.total_load)  # disabled
panel_52 = Panel(ma_2.Result)  # disabled
panel_53 = Panel("80")  # disabled
panel_54 = Panel("19")  # disabled
panel_55 = Panel("50")  # disabled
timeop = LBTimeIntervalOperation(data=loadbalance.norm_bal_storage)  # -> daily, monthly, mon_per_hr; plug-in component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
colrange_2 = LBColorRange(index=panel_54)  # -> colors; disabled; plug-in component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
monthlychart = LBMonthlyChart(
    data=annualloads.balance,
    base_pt=pt_3,
    x_dim=panel_50,
    y_dim=panel_53,
    stack=toggle_9,
    global_title=python_7,
    legend_par=legendpar)  # -> report, data_mesh, data_lines, legend, borders, labels, y_title, title; disabled; plug-in component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
loadbalance_2 = HBThermalLoadBalance(
    rooms_model=flatten(data_6),
    cooling=roomenergyresult_2.cooling,
    heating=roomenergyresult_2.heating,
    lighting=roomenergyresult_2.lighting,
    electric_equip=roomenergyresult_2.electric_equip,
    gas_equip=roomenergyresult_2.gas_equip,
    people_gain=roomenergyresult_2.people_gain,
    solar_gain=roomenergyresult_2.solar_gain,
    infiltration_load=roomenergyresult_2.infiltration_load,
    mech_vent_load=roomenergyresult_2.mech_vent_load,
    face_energy_flow=faceresult_2.face_energy_flow)  # -> report, balance, balance_storage, norm_bal, norm_bal_storage; plug-in component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
neg_2 = Negative(Value=panel_55)  # disabled
panel_56 = Panel("1.5")  # disabled
# EUI
panel_57 = Panel("-125")
legendpar_2 = LBLegendParameters(min=neg_2, max=panel_55, colors=colrange_2, text_height=panel_56)  # -> leg_par; disabled; plug-in component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
neg_3 = Negative(Value=panel_57)
toggle_10 = BooleanToggle(True)  # disabled
colrange_3 = LBColorRange(index="19")  # -> colors; plug-in component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
pt_4 = Point(Point(293, -113, 0))
pt_5 = Point(Point(211, -113, 0))  # disabled
neg_4 = Negative(Value="50")
panel_58 = Panel("5")  # disabled
panel_59 = Panel("80")  # disabled
legendpar_3 = LBLegendParameters(min=panel_57, max=neg_3)  # -> leg_par; disabled; plug-in component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
timeop_2 = LBTimeIntervalOperation(data=loadbalance_2.norm_bal_storage)  # -> daily, monthly, mon_per_hr; plug-in component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
normbyflr = HBNormalizeByFloorArea(data=roomenergyresult.cooling, model=data_9)  # -> total_data, room_data; plug-in component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
normbyflr_2 = HBNormalizeByFloorArea(data=roomenergyresult.heating, model=data_9)  # -> total_data, room_data; plug-in component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
normbyflr_3 = HBNormalizeByFloorArea(data=roomenergyresult.lighting, model=data_9)  # -> total_data, room_data; plug-in component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
normbyflr_4 = HBNormalizeByFloorArea(data=roomenergyresult.electric_equip, model=data_9)  # -> total_data, room_data; plug-in component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
pt_6 = Point(Point(211, -113, 0))
monthlychart_2 = LBMonthlyChart(
    data=annualloads_2.balance,
    base_pt=pt_5,
    x_dim=panel_58,
    y_dim=panel_59,
    stack=toggle_10,
    global_title=python_8,
    legend_par=legendpar_2)  # -> report, data_mesh, data_lines, legend, borders, labels, y_title, title; disabled; plug-in component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
move = Move(Geometry=pt_6, Motion="2.5, 0, 0")  # -> Geometry, Transform
# EUI
panel_60 = Panel("-125")
colorrooms = HBColorRooms(data=flatten(roomenergyresult.heating), rooms_model=flatten(data_9))  # -> report, mesh, wire_frame, legend, title, rooms, colors, values; disabled; plug-in component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
colorfaces = HBColorFaces(data=flatten(faceresult.face_energy_flow), hb_objs=flatten(data_9), legend_par=legendpar_3)  # -> report, mesh, wire_frame, legend, title, faces, colors, values; plug-in component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
neg_5 = Negative(Value=panel_60)
xdata_5 = LBDeconstructData(data=[normbyflr_2.total_data, normbyflr.total_data, normbyflr_3.total_data, normbyflr_4.total_data])  # -> header, values; plug-in component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
xheader = LBDeconstructHeader(header=xdata_5.header)  # -> data_type, unit, a_period, metadata; plug-in component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
legendpar_4 = LBLegendParameters(min=panel_60, max=neg_5)  # -> leg_par; disabled; plug-in component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
normbyflr_5 = HBNormalizeByFloorArea(data=roomenergyresult_2.cooling, model=data_10)  # -> total_data, room_data; plug-in component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
normbyflr_6 = HBNormalizeByFloorArea(data=roomenergyresult_2.heating, model=data_10)  # -> total_data, room_data; plug-in component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
normbyflr_7 = HBNormalizeByFloorArea(data=roomenergyresult_2.lighting, model=data_10)  # -> total_data, room_data; plug-in component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
normbyflr_8 = HBNormalizeByFloorArea(data=roomenergyresult_2.electric_equip, model=data_10)  # -> total_data, room_data; plug-in component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
bang = ExplodeTree(Data=simplify(xdata_5.values))  # -> Branch0, Branch1, Branch2, Branch3
colrange_4 = LBColorRange(index="19")  # -> colors; plug-in component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
neg_6 = Negative(Value="50")
python_9 = GhPythonScript(x=xheader.metadata)  # -> simplify(a)
# ---------- python_9: Python ----------
a = ""
for _x in x.split(" ")[-3:]:
    a += _x + " "
# ---------- end python_9 ----------
legendpar_5 = LBLegendParameters(min=neg_4, max="50", colors=colrange_3, base_plane=pt_4, text_height="1.5")  # -> leg_par; plug-in component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
monthlychart_3 = LBMonthlyChart(
    data=timeop.monthly,
    base_pt=move.Geometry,
    x_dim="5",
    y_dim="80",
    stack=Toggle(True),
    global_title=python_8,
    legend_par=legendpar_5)  # -> report, data_mesh, data_lines, legend, borders, labels, y_title, title; plug-in component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
multiplication = Multiplication(A=bang.Branch1, B="0.333")
multiplication_2 = Multiplication(A=bang.Branch0, B="1.25")
legendpar_6 = LBLegendParameters(min=neg_6, max="50", colors=colrange_4, text_height="1.5")  # -> leg_par; plug-in component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
colorrooms_2 = HBColorRooms(data=flatten(roomenergyresult_2.heating), rooms_model=flatten(data_10))  # -> report, mesh, wire_frame, legend, title, rooms, colors, values; disabled; plug-in component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
colorfaces_2 = HBColorFaces(data=flatten(faceresult_2.face_energy_flow), hb_objs=flatten(data_10), legend_par=legendpar_4)  # -> report, mesh, wire_frame, legend, title, faces, colors, values; plug-in component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
panel_61 = Panel(python_9)
xdata_6 = LBDeconstructData(data=[normbyflr_6.total_data, normbyflr_5.total_data, normbyflr_7.total_data, normbyflr_8.total_data])  # -> header, values; plug-in component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
xheader_2 = LBDeconstructHeader(header=xdata_6.header)  # -> data_type, unit, a_period, metadata; plug-in component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
ma_3 = MassAddition(Input=[multiplication, multiplication_2, bang.Branch2, bang.Branch3])  # -> Result, PartialResults
pt_7 = Point(Point(211, -113, 0))
ma_4 = MassAddition(Input=flatten(ma_3.Result))  # -> Result, PartialResults
bang_2 = ExplodeTree(Data=simplify(xdata_6.values))  # -> Branch0, Branch1, Branch2, Branch3
monthlychart_4 = LBMonthlyChart(
    data=timeop_2.monthly,
    base_pt=pt_7,
    x_dim="5",
    y_dim="80",
    stack=Toggle(True),
    global_title=python_8,
    legend_par=legendpar_6)  # -> report, data_mesh, data_lines, legend, borders, labels, y_title, title; plug-in component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
python_10 = GhPythonScript(x=xheader_2.metadata)  # -> simplify(a); same code as python_9
panel_62 = Panel(ma_4.Result)
panel_63 = Panel(ma_3.Result)
multiplication_3 = Multiplication(A=bang_2.Branch1, B="0.333")
multiplication_4 = Multiplication(A=bang_2.Branch0, B="1.25")
panel_64 = Panel(python_10)
ma_5 = MassAddition(Input=[multiplication_3, multiplication_4, bang_2.Branch2, bang_2.Branch3])  # -> Result, PartialResults
ma_6 = MassAddition(Input=flatten(ma_5.Result))  # -> Result, PartialResults
panel_65 = Panel(ma_6.Result)
panel_66 = Panel(ma_5.Result)

# ----
# HVAC
# Zone Air
panel_67 = Panel(xdata_4.values)

# ----
# w/o HVAC
# Outdoor Air
# Zone Air
panel_68 = Panel(xdata_2.values)
panel_69 = Panel(xdata.values)
