# Grasshopper definition sky_temps.gh (Grasshopper 1.0.7)

panel = Panel("https://www.energyplus.net/weather-download/north_and_central_america_wmo_region_4/USA/PA/USA_PA_Philadelphia.Intl.AP.724080_TMY3/all")
outdoorsolarmrt = LBOutdoorSolarMRT()  # -> report, short_erf, long_erf, short_dmrt, long_dmrt, mrt; plug-in component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
downloadepw = LBDownloadWeather(weather_URL=panel)  # -> epw_file, stat_file, ddy_file; plug-in component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
utci = LBUTCIComfort()  # -> report, utci, comfort, condition, category, comf_obj; plug-in component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
importepw = LBImportEPW(epw_file=downloadepw.epw_file)  # -> location, dry_bulb_temperature, dew_point_temperature, relative_humidity, wind_speed, wind_direction, direct_normal_rad, diffuse_horizontal_rad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; plug-in component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
pt = Point(Point(1.750715688, 110.9033564, 0))
xdata = LBDeconstructData(data=importepw.horizontal_infrared_rad)  # -> header, values; plug-in component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
neg = Negative(Value="30")
division = Division(A=xdata.values, B="5.67e-8")
pow = Power(A=division, B="0.25")
legendpar = LBLegendParameters(
    min=neg,
    max="30",
    colors=[ColourSwatch(SwatchColor=RGB(0, 255, 255)), ColourSwatch(SwatchColor=RGB(255, 255, 255)), ColourSwatch(SwatchColor=RGB(255, 0, 0))])  # -> leg_par; plug-in component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
hourlyplot = LBHourlyPlot(data=importepw.dry_bulb_temperature, base_pt=pt, legend_par=legendpar)  # -> report, mesh, legend, borders, labels, title; plug-in component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
subtraction = Subtraction(A=pow, B="273.15")
data = LBConstructData(header=xdata.header, values=subtraction)  # -> data; plug-in component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
hourlyplot_2 = LBHourlyPlot(data=data, legend_par=legendpar)  # -> report, mesh, legend, borders, labels, title; plug-in component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
xdata_2 = LBDeconstructData(data=importepw.dry_bulb_temperature)  # -> header, values; plug-in component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
subtraction_2 = Subtraction(A=xdata_2.values, B=subtraction)
panel_2 = Panel(subtraction)
data_2 = LBConstructData(header=xdata_2.header, values=subtraction_2)  # -> data; plug-in component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
pt_2 = Point(Point(1.753010785, -122.981302, 0))
hourlyplot_3 = LBHourlyPlot(data=data_2, base_pt=pt_2)  # -> report, mesh, legend, borders, labels, title; plug-in component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
