# Grasshopper definition view_factor_pure_gh.gh (Grasshopper 1.0.7)
# plug-ins: Bifocals

panel = Panel("http://climate.onebuilding.org/WMO_Region_4_North_and_Central_America/USA_United_States_of_America/NV_Nevada/USA_NV_Reno-Tahoe.Intl.AP.724880_TMY3.zip")
downloadepw = LBDownloadWeather(weather_URL=panel)  # -> epw_file, stat_file, ddy_file; plug-in component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
importstat = LBImportSTAT(stat_file=downloadepw.stat_file)  # -> location, ashrae_zone, koppen_zone, clear_dir_norm_rad, clear_diff_horiz_rad, ann_heat_dday_996, ann_heat_dday_990, ann_cool_dday_004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; plug-in component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
importepw = LBImportEPW(epw_file=downloadepw.epw_file)  # -> location, dry_bulb_temperature, dew_point_temperature, relative_humidity, wind_speed, wind_direction, direct_normal_rad, diffuse_horizontal_rad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; plug-in component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
rectangle = Rectangle(Plane=PlaneXY(0, 0, 0), XSize=Slider(5, range=0..10), YSize=Slider(8, range=0..10), Radius=0)  # -> Rectangle, Length
boxrec = BoxRectangle(Rectangle=rectangle.Rectangle, Height=Slider(3, range=2..6))
roomsolid = HBRoomFromSolid(geo=flatten(boxrec), name="mrt_room", conditioned=True)  # -> report, rooms; plug-in component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
facparam = HBFacadeParameters(north=0, east=0, south=0, west=Slider(0.9, range=0..1))  # -> fac_par; plug-in component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
aperturesbyratio = HBAperturesByRatio(hb_objs=flatten(roomsolid.rooms), ratio=facparam, subdivide=Toggle(False))  # -> report, hb_objs; plug-in component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
vizbymrttype = HBVisualizeByRoomMRTType(hb_objs=aperturesbyratio.hb_objs)  # -> windows, room_walls, room_roofs, room_floors, radiant_panels; plug-in component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
merge = Merge(Data1=vizbymrttype.room_walls, Data2=vizbymrttype.room_roofs, Data3=vizbymrttype.room_floors)  # -> simplify(Result)
wires = BrepWireframe(
    Brep=[vizbymrttype.windows, vizbymrttype.room_walls, vizbymrttype.room_roofs, vizbymrttype.room_floors, vizbymrttype.radiant_panels],
    Density=-1)
custom_mesh_settings = SettingsCustom(
    StitchSeams=True,
    SimplePlanes=False,
    Refine=True,
    MinCount=16,
    MaxCount=400,
    AspectRatio=20,
    MaxDistance=0,
    MaxAngle=20,
    MinEdge=0,
    MaxEdge=0)
area = Area(Geometry=vizbymrttype.room_floors)  # -> Area, Centroid
Z = UnitZ(Factor="1.5")
gridrooms = HBSensorGridFromRooms(rooms=aperturesbyratio.hb_objs, grid_size="2", dist_floor="1")  # -> grid, points, mesh; plug-in component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
move = Move(Geometry=area.Centroid, Motion=Z)  # -> Geometry, Transform
geo = Geometry(vizbymrttype.windows)

# ----
# lim VF => 0.5
# VF converges to 0.5 as scale => inf
area_2 = Area(Geometry=geo)  # -> Area, Centroid
scale = Scale(Geometry=geo, Center=area_2.Centroid, Factor="1")  # -> Geometry, Transform

mesh = MeshBrep(Brep=geo, Settings=custom_mesh_settings)
preview = CustomPreview(Geometry=mesh, Material=ColourSwatch(SwatchColor=RGB(0, 255, 255)))
pt = Point(gridrooms.points)

python = GhPythonScript(pt0=move.Geometry, run=Toggle(True))  # -> out, pt0s, pts
# ---------- python: Python ----------
import rhinoscriptsyntax as rs
import math 

d2r = lambda deg: deg * (math.pi / 180.0)
radius = 3.0
eps = 10
pt0s, pts = [], []

if not run:
    assert False 

pt0 = rs.coerce3dpoint(pt0)
x0, y0, z0 = pt0.X, pt0.Y, pt0.Z
z = z0
for i in range(0, 360, eps):
    theta = d2r(i)
    y = (radius * math.sin(theta)) + y0
    x = (radius * math.cos(theta)) + x0
    pts.append(rs.AddPoint(x, y, z))
    pt0s.append(rs.AddPoint(x0, y0, z))
#for j in range(0, 90, eps):
#    phi = d2r(j)
#    z = (radius * math.sin(phi)) + z0
#    rad_ =  radius - (radius * math.sin(phi))
#    if rad_ < 0.5: continue
# ---------- end python ----------
vec2pt = Vector2Pt(PointA=python.pt0s, PointB=python.pts, Unitize=False)  # -> Vector, Length
vdis = VectorDisplay(Anchor=python.pt0s, Vector=vec2pt.Vector)

msphere = MeshSphere(Base=move.Geometry, Radius="1", UCount="20", VCount="20")  # -> simplify(Mesh)
tri = Triangulate(Mesh=msphere)  # -> Mesh, Count
demesh = DeconstructMesh(Mesh=tri.Mesh)  # -> Vertices, Faces, Colours, Normals
deface = DeconstructFace(Face=demesh.Faces)  # -> CornerA, CornerB, CornerC, CornerD
relay = Relay([deface.CornerA, deface.CornerB, deface.CornerC, deface.CornerD])
item = ListItem(List=demesh.Vertices, Index=relay, Wrap=True)
vec2pt_2 = Vector2Pt(PointA=move.Geometry, PointB=item, Unitize=Toggle(True))  # -> Vector, Length
lng = ListLength(List=pt)
dup = DuplicateData(Data=graft(demesh.Vertices), Number=graft(lng), Order=True)  # -> simplify(Data)
dup_2 = DuplicateData(Data=graft(demesh.Faces), Number=graft(lng), Order=True)  # -> simplify(Data)
occ = Occlusion(Samples=pt, Obstructions=mesh, Rays=vec2pt_2.Vector)  # -> Hits, simplify(Occlusion)
subtraction = Subtraction(A="1", B=occ.Occlusion)
gradient = Gradient(LowerLimit=0, UpperLimit=1, Parameter=subtraction, stops=[0: RGB(0, 128, 0), 0.5: RGB(255, 255, 0), 1: RGB(255, 0, 0)])
vec2pt_3 = Vector2Pt(PointA=move.Geometry, PointB=pt, Unitize=False)  # -> graft(Vector), Length
flip = FlipMatrix(Data=dup)
flip_2 = FlipMatrix(Data=dup_2)
move_2 = Move(Geometry=flip, Motion=vec2pt_3.Vector)  # -> Geometry, Transform
neg = Negative(Value=occ.Occlusion)
viewer = ParamViewer(move_2.Geometry)
lng_2 = ListLength(List=flatten(occ.Occlusion))
num = Number(flatten(occ.Occlusion))
panel_2 = Panel(tri.Mesh)
viewer_2 = ParamViewer(occ.Occlusion)
multiplication = Multiplication(A=neg, B=vec2pt_2.Vector)  # -> simplify(Result); disabled
ma = MassAddition(Input=num)  # -> Result, PartialResults
ma_2 = MassAddition(Input=lng_2)  # -> Result, PartialResults
conmesh = ConstructMesh(Vertices=move_2.Geometry, Faces=flip_2, Colours=gradient)
vdis_2 = VectorDisplay(Anchor=graft(pt), Vector=multiplication)  # disabled
panel_3 = Panel([ma.Result, ma_2.Result])

# ----
# View Factor to Window
ma_3 = MassAddition(Input=occ.Occlusion)  # -> flatten(Result), PartialResults
lng_3 = ListLength(List=occ.Occlusion)  # -> flatten(Length)
division = Division(A=ma_3.Result, B=lng_3)

multiplication_2 = Multiplication(A="100", B=division)
round = Round(Number=multiplication_2)  # -> Nearest, Floor, Ceiling

# ----
# Visualize Total MRT
panel_4 = Panel(round.Nearest)

# ----
# Visualize
# PMV Comfort
# PMV input for viz
tag = TextTag(Location=pt, Text=round.Nearest)
