# Grasshopper definition material_deconstruct.gh (Grasshopper 1.0.7)
# plug-ins: Bifocals

loadbalance = HBThermalLoadBalance()  # -> report, balance, balance_storage, norm_bal, norm_bal_storage; plug-in component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
bldgvintages = HBBuildingVintages({"ASHRAE 90.1 2013  |  IECC 2015": "2013", "ASHRAE 90.1 2010  |  IECC 2012": "2010", "ASHRAE 90.1 2007  |  IECC 2009": "2007", "ASHRAE 90.1 2004  |  IECC 2006": "2004", "1980-2004 (CBECS)": "1980_2004", "Pre-1980 (CBECS)": "pre_1980"}, selected="ASHRAE 90.1 2013  |  IECC 2015")
bldgvintages_2 = HBBuildingVintages({"ASHRAE 90.1 2013  |  IECC 2015": "2013", "ASHRAE 90.1 2010  |  IECC 2012": "2010", "ASHRAE 90.1 2007  |  IECC 2009": "2007", "ASHRAE 90.1 2004  |  IECC 2006": "2004", "1980-2004 (CBECS)": "1980_2004", "Pre-1980 (CBECS)": "pre_1980"}, selected="ASHRAE 90.1 2013  |  IECC 2015")
climatezones = HBClimateZones({"1 - Very Hot": "1", "2 - Hot": "2", "3 - Warm": "3", "4 - Mixed": "4", "5 - Cool": "5", "6 - Cold": "6", "7 - Very Cold": "7", "8 - Subarctic": "8"}, selected="4 - Mixed")
bldgprograms = HBBuildingPrograms({"LargeOffice", "MediumOffice", "SmallOffice", "MidriseApartment", "HighriseApartment", "Retail", "StripMall", "PrimarySchool", "SecondarySchool", "SmallHotel", "LargeHotel", "Hospital", "Outpatient", "Laboratory", "Warehouse", "SuperMarket", "FullServiceRestaurant", "QuickServiceRestaurant", "Courthouse", "LargeDataCenterHighITE", "LargeDataCenterLowITE", "SmallDataCenterHighITE", "SmallDataCenterLowITE"}, selected="MidriseApartment")
vizbybc = HBVizualizeByBC()  # -> outdoors, surface, ground, adiabatic, other, wire_frame; plug-in component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
windowmat = HBWindowMaterial()  # -> mat; plug-in component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
# Calculate VLT from SHGC
panel = Panel("""0.2
0.5
0.7""")
constrsetclimate = HBConstructionSetByClimate(climate_zone=climatezones, vintage=bldgvintages)  # -> constr_set; plug-in component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
tvis_from_shgc = GhPythonScript(shgc=panel)  # -> t_vis; inputs shgc: list
# ---------- tvis_from_shgc: Python ----------
# Set constants
B = [0.90535007, 0.07800939]
pred_tvis = lambda _x: (_x * B[0]) + B[1] 

if _shgc:
    t_vis = [0] * len(_shgc)
    for i, x in enumerate(_shgc):
        assert 1.0 >= x >= 0.0, \
            '_shgc must be between 1.0 and 0.0. Got: {}'.format(x)
        t_vis[i] = pred_tvis(x)
# ---------- end tvis_from_shgc ----------
searchconstrset = HBSearchConstructionSets()  # -> constr_sets; plug-in component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
searchprog = HBSearchPrograms(bldg_prog=bldgprograms, vintage=bldgvintages_2)  # -> room_prog; plug-in component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
panel_2 = Panel(tvis_from_shgc)
# Calculate SHGC from VLT
shgc_from_tvis = GhPythonScript(t_vis=panel_2)  # -> shgc; inputs t_vis: list
# ---------- shgc_from_tvis: Python ----------
# Set constants
B = [0.90535007, 0.07800939]
pred_shgc = lambda _x: (_x / B[0]) - (B[1] / B[0]) 

if _t_vis:
    shgc = [None] * len(_t_vis)
    for i, x in enumerate(_t_vis):
        assert 1.0 >= x >= 0.0, \
            '_t_viz must be between 1.0 and 0.0. Got: {}'.format(x)
        shgc[i] = pred_shgc(x)
# ---------- end shgc_from_tvis ----------
panel_3 = Panel(shgc_from_tvis)
opaquematnomass = HBOpaqueMaterialNoMass(r_value="4")  # -> mat; plug-in component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
searchconstrs = HBSearchConstructions(keywords="exterior mass wall")  # -> opaque_constrs, window_constrs, shade_constrs; plug-in component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
blendprograms = HBBlendProgramTypes(name="BlendedMidRise", programs=searchprog)  # -> program; plug-in component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
opaqueconstr = HBOpaqueConstruction(name="wall_constr", materials=opaquematnomass)  # -> constr; plug-in component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
panel_4 = Panel(blendprograms)
panel_5 = Panel(searchconstrs.opaque_constrs)
decnstrconstr = HBDeconstructConstruction(constr=opaqueconstr)  # -> materials, layers, r_val_si, r_val_ip, u_fac_si, u_fac_ip, t_sol, t_vis; plug-in component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
panel_6 = Panel(decnstrconstr.r_val_si)
item = ListItem(List=searchconstrs.opaque_constrs, Index=0, Wrap=True)
decnstrconstr_2 = HBDeconstructConstruction(constr=searchconstrs.opaque_constrs)  # -> materials, layers, r_val_si, r_val_ip, u_fac_si, u_fac_ip, t_sol, t_vis; plug-in component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
panel_7 = Panel(decnstrconstr_2.r_val_si)
